# Grasshopper definition dotNETwebRequest.gh (Grasshopper 1.0.7)

# Steps to Follow:
# 
# 1. None
panel = Panel("")

# ----
# .NET Web Request refactored to Python
panel_3 = Panel("""Darrel Ronald
darrel@spatiomatics.com""")

c_script = CSharpScript()  # -> out
# ---------- c_script: C# usings ----------
using System.IO;
using System.Linq;
using System.Data;
using System.Drawing;
using System.Reflection;
using System.Windows.Forms;
using System.Xml;
using System.Xml.Linq;
using System.Runtime.InteropServices;

using Rhino.DocObjects;
using Rhino.Collections;
using GH_IO;
using GH_IO.Serialization;
# ---------- c_script: C# ----------
    var request = System.Net.WebRequest.Create(@"https://yesno.wtf/api");
    request.Timeout = 1000;
    request.Method = "GET";

    try
    {
      using (var response = request.GetResponse())
      {
        using (var stream = response.GetResponseStream())
        {
          var reader = new StreamReader(stream, System.Text.Encoding.UTF8);
          Print(reader.ReadToEnd());
        }
      }
    }
    catch (System.Net.WebException e)
    {
      Print(e.Message);
    }
# ---------- end c_script ----------
python = GhPythonScript()  # -> out
# ---------- python: Python ----------
"""
This is a refactored Python script of Luis Fraguada.
https://discourse.mcneel.com/t/c-call-rest-client-with-x-api-key-within-grasshopper/51581 

It uses the .NET modules for making a URL request: System.Net.WebRequest
Note: These modules are no longer to be used for web requests.

Output:
Response or Exception from the url

"""

__author__ = "Darrel Ronald"
__version__ = "2020"

import System

# https://docs.microsoft.com/en-us/dotnet/api/system.net.webrequest.create?view=netcore-3.1
url = "https://yesno.wtf/api"

def webRequest():

    request = System.Net.WebRequest.Create(url)
    #request.Credentials = ""
    #request.Headers.Add("Authentication", "api-key YOURAPIKEY")
    request.Timeout = 1000
    request.Method = "GET"
    print(request)

    try:
        response = request.GetResponse()
        #print(response)
        stream = response.GetResponseStream()
        reader = System.IO.StreamReader(stream)
        print(reader.ReadToEnd())
    except:
        e = System.Net.WebException()
        print(e.Message)

webRequest()
# ---------- end python ----------
python_2 = GhPythonScript()  # -> out
# ---------- python_2: Python ----------
import sys
import urllib2

__author__ = "Darrel Ronald"
__version__ = "2020"

# Python Module URLLIB
# https://docs.python.org/3/library/urllib.request.html#module-urllib.request


url = "https://yesno.wtf/api"

request = urllib.urlopen(url)
print(request)
# ---------- end python_2 ----------
panel_4 = Panel(c_script)
panel_5 = Panel(python_2)
panel_6 = Panel(python)
panel_7 = Panel("2020")

# ---- group: Description + Plugins
# Description:
# This python script is a refactoring of the C# component by Luis Fraguada on McNeel Discourse:  https://discourse.mcneel.com/t/c-call-rest-client-with-x-api-key-within-grasshopper/51581
panel_8 = Panel("""Plugins:
None""")
