# Grasshopper definition ImportSysExplorer_0.1.0.gh (Grasshopper 1.0.7)

# Steps to Follow:
# 
# 1. No actions required
python = GhPythonScript()  # -> out, sysModules, sysPaths
#   port sysModules: None the IronPython sys.builtin_module_names
# ---------- python: Python ----------
"""
Learn about sys modules and paths.
    Inputs:
        None
    Output:
        sysModules: the IronPython sys.builtin_module_names
        sysPatsh: the searched directories from Rhino
"""

__author__ = "Darrel Ronald"
__version__ = "2020"

import sys
sysModules = sorted(sys.builtin_module_names)
sysPaths = sys.path
# ---------- end python ----------

# ----
# Import sys to understand some contents
panel_3 = Panel("""Darrel Ronald
darrel@spatiomatics.com""")

sys_builtin_module_names = Panel(python.sysModules)
panel_4 = Panel("2020")
sys_path = Panel(python.sysPaths)

# ---- group: Description + Plugins
# Description:
# 
# sysModules shows you what modules you can import from IronPython.
# 
# sys.path shows you where Rhino is searching for imports automatically. You can add new paths for other downloaded python modules
panel_5 = Panel("""Plugins:
None""")
