# Grasshopper definition ListOfRhinoCommands_0.1.0.gh (Grasshopper 1.0.7)

# Steps to Follow:
# 
# 1. Set the boolean toggle to True
panel = Panel("")
python = GhPythonScript(run=Toggle(True))  # -> out, commands; inputs run: Boolean
# ---------- python: Python ----------
"""Generate a sorted list of Rhino Commands.
    Inputs:
        run: bool to set True (to run) or False
    Output:
        commands: a sorted list of all Rhino Commands"""

__author__ = "Darrel Ronald"
__version__ = "0.1.0"

import Rhino

commands = []

if run == True:
    commands = Rhino.Commands.Command.GetCommandNames(True, False)
    commands = sorted(commands)
# ---------- end python ----------

# ----
# List Of Rhino Commands
panel_3 = Panel("""Darrel Ronald
darrel@spatiomatics.com""")

panel_4 = Panel(python.commands)
panel_5 = Panel("2020")

# ---- group: Description + Plugins
# Description:
# 
# Python Grasshopper script for generating a list of all the RhinoCommon commands that you can access. The list is sorted by alphabet.
panel_6 = Panel("""Plugins:
None""")
