# Grasshopper definition ScriptContextChanger_0.1.0.gh (Grasshopper 1.0.7)

panel_3 = Panel("""Darrel Ronald
darrel@spatiomatics.com""")

# ----
# Script Context Changer
# Steps to Follow:
# 
# 1. Select either the Rhino or Grasshopper context.
list = ValueList({"Rhino": 1, "Grasshopper": 2}, selected="Grasshopper")
python = GhPythonScript(ScriptContext=list)  # -> out, ActiveContext; inputs ScriptContext: Int32
# ---------- python: Python ----------
"""Script Context Changer.
    Inputs:
        ScriptContext: Your chosen script context
    Output:
        ActiveContext: The active script context"""

__author__ = "Darrel Ronald"
__version__ = "2020"

#----imports
import Rhino as rh
import rhinoscriptsyntax as rs
import scriptcontext as sc

#ScriptContext

if ScriptContext == 1:
    # set ScriptContext.doc to Rhino where sc.id = 1
    sc.doc = sc.id = 1 
    whatContext = rs.ContextIsRhino()
    print whatContext
    print sc.id
    ActiveContext = "Rhino"
elif ScriptContext == 2:
    # set ScriptContext.doc to Grasshopper where sc.id = 2
    sc.doc = sc.id = 2
    whatContext = rs.ContextIsGrasshopper()
    print whatContext
    print sc.id
    ActiveContext = "Grasshoper"
# ---------- end python ----------
panel_4 = Panel("2020")
panel_5 = Panel(python.ActiveContext)

# ---- group: Description + Plugins
# Description:
# 
# This is more of a learning tool. In the Python script accompanying, you can pull out the code to set changes in scriptcontext.id when you're writing scripts with RhinoCommon and need to change the scriptcontext. Otherwise, with Rhinoscriptsyntax imported, this is done automatically
panel_6 = Panel("""Plugins:
None""")
