# Grasshopper definition xxx-urllib.gh (Grasshopper 1.0.7)

# Steps to Follow:
# 
# 1.
python = GhPythonScript()  # -> out, a
# ---------- python: Python ----------
__author__ = "Darrel Ronald"
__version__ = "2020"

import urllib
import urllib2

dir(urllib)
dir(urllib2)
# ---------- end python ----------

# ----
# Script Title
panel_3 = Panel("""Darrel Ronald
darrel@spatiomatics.com""")

panel_4 = Panel(python.out)
panel_5 = Panel("2020")

# ---- group: Description + Plugins
panel_6 = Panel("Description:")
panel_7 = Panel("""Plugins:
None""")
